# Grasshopper definition lampshade.gh (Grasshopper 1.0.7)
# plug-ins: LunchBox

brep = Brep(<brep referenced from the Rhino model>)
srf = Surface(<surface referenced from the Rhino model>)  # disabled
debrep = DeconstructBrep(Brep=brep)  # -> Faces, Edges, Vertices
number_slider = Slider(5, range=0..10)  # disabled
number_slider_2 = Slider(0.07, range=0..10)  # disabled
number_slider_3 = Slider(0.07, range=0..10)  # disabled
hex = HexagonalStructure(Surface=debrep.Faces, UDivisions=10, VDivisions=10, AdjustShape=0.3, Type=False)  # -> StructureLines, StructureNodes
hex_2 = HexagonalStructure(Surface=srf, UDivisions=10, VDivisions=10, AdjustShape=0.3, Type=False)  # -> StructureLines, StructureNodes; disabled
number_slider_4 = Slider(6, range=0..100)  # disabled
number_slider_5 = Slider(2, range=0..10)  # disabled
hex_3 = HexagonCells(Surface=srf, UDivisions=10, VDivisions=10, TParameter=0.25)  # -> HexagonCells, Centers; disabled
pipe = Pipe(Curve=hex_2.StructureLines, Radius=number_slider, Caps=number_slider_5)  # disabled
join = JoinCurves(Curves=hex.StructureLines, Preserve=False)
offset = OffsetSurface(Surface=srf, Distance=number_slider_4, Retrim=True)  # disabled
join_2 = BrepJoin(Breps=pipe)  # -> Breps, Closed; disabled
rulesrf = RuledSurface(CurveA=offset, CurveB=srf)  # disabled
loft = Loft(Options={Adjust=False, Closed=False, LoftEnds=0, LoftSimp=0, LoftType=0, Rebuild=10, Refit=0.01})  # disabled
pipe_2 = Pipe(Curve=join, Radius=Slider(0.5, range=0..1), Caps=0)
join_3 = BrepJoin(Breps=[rulesrf, offset, srf])  # -> Breps, Closed; disabled
brep_2 = Brep(join_3.Breps)  # disabled
brep_3 = Brep(join_2.Breps)  # disabled
mesh = Mesh(brep_3)  # disabled
mesh_2 = Mesh(brep_2)  # disabled
msplit = MeshSplit(Mesh=mesh_2, Splitters=mesh)  # disabled
